# Grasshopper definition lca-gwp-ec3-okobaudat-swiflet.gh (Grasshopper 1.0.7)
# plug-ins: Swiftlet

# ----
# Search :)
panel = Panel("concrete")

# ---- group: Password
panel_2 = Panel("your-password")

# ---- group: Username
# EC3 Account
panel_3 = Panel("your@email.com")

# ----
# EC3
panel_4 = Panel("https://buildingtransparency.org/api")

# ----
# Auth EC3
username = Data(panel_3)
password = Data(panel_2)
merge = Merge(Data1=username, Data2=password)
panel_5 = Panel("""username
password""")
cjv = CreateJSONValue(Value=merge)
cjo = CreateJSONObject(Keys=panel_5, Values=cjv)
concat = Concatenate(FragmentA=panel_4, FragmentB="/rest-auth/login")
ctb = CreateTextBody(Content=cjo, IsHtmlChecked=False, IsJavascriptChecked=False, IsJsonChecked=True, IsTextChecked=False, IsXmlChecked=False)
post = POSTRequest(URL=concat, Body=ctb)  # -> Status, Content, Response
panel_6 = Panel(post.Status)
pjs = ParseJSONString(Text=post.Content)
gjok = GetJSONObjectKey(JObject=pjs, Key="key")
sjt = StringifyJSONToken(JToken=gjok)
ec3_auth_token = Text(sjt)

# ----
# Okobaudat
panel_7 = Panel("https://oekobaudat.de/OEKOBAU.DAT/resource/datastocks/cd2bda71-760b-4fcc-8a0b-3877c10000a8")

# ----
# Query dataset processes
panel_8 = Panel("/processes")
search_input = Data(panel)
panel_9 = Panel("""JSON
true
en""")
merge_2 = Merge(Data1=search_input, Data2=panel_9)
panel_10 = Panel("""name
format
search
lang""")
cqp = CreateQueryParam(Key=panel_10, Value=merge_2)
concat_2 = Concatenate(FragmentA=panel_7, FragmentB=panel_8)
get = GETRequest(URL=concat_2, Params=cqp)  # -> Status, Content, Response

# ----
# Get process UUID
pjs_2 = ParseJSONString(Text=get.Content)
gjok_2 = GetJSONObjectKey(JObject=pjs_2, Key="data")
rja = ReadJSONArray(Array=gjok_2)
gjok_3 = GetJSONObjectKey(JObject=graft(rja), Key="name")
gjok_4 = GetJSONObjectKey(JObject=graft(rja), Key="uuid")
rjv = ReadJSONValue(JValue=gjok_4)  # -> AsString, AsNumber, AsBool
rjv_2 = ReadJSONValue(JValue=gjok_3)  # -> simplify(AsString), AsNumber, AsBool
process_uuid = Data(flatten(rjv.AsString))
process_names = Data(rjv_2.AsString)

# ----
# Data Query
panel_11 = Panel("/materials")
ec3_auth_token_2 = Text(ec3_auth_token)
search_input_2 = Data(panel)
bearer = BearerTokenAuth(Token=ec3_auth_token_2)
cqp_2 = CreateQueryParam(Key="name__like", Value=search_input_2)
concat_3 = Concatenate(FragmentA=panel_4, FragmentB=panel_11)
get_2 = GETRequest(URL=concat_3, Params=cqp_2, Headers=bearer)  # -> Status, Content, Response
pjs_3 = ParseJSONString(Text=get_2.Content)
panel_12 = Panel("""name
gwp_per_kg""")
rja_2 = ReadJSONArray(Array=pjs_3)
gjok_5 = GetJSONObjectKey(JObject=graft(rja_2), Key=panel_12)
rjv_3 = ReadJSONValue(JValue=gjok_5)  # -> AsString, AsNumber, AsBool
gjok_6 = GetJSONObjectKey(JObject=graft(rja_2), Key="manufacturer")
gjok_7 = GetJSONObjectKey(JObject=gjok_6, Key="address")
rjv_4 = ReadJSONValue(JValue=gjok_7)  # -> AsString, AsNumber, AsBool
merge_3 = Merge(Data1=rjv_3.AsString, Data2=rjv_4.AsString)

# ----
# LCIA Processes Results
panel_13 = Panel("/processes/")
concat_4 = Concatenate(FragmentA=panel_7, FragmentB=panel_13, FragmentC=process_uuid)
cqp_3 = CreateQueryParam(Key="format", Value="JSON")
get_3 = GETRequest(URL=concat_4, Params=cqp_3)  # -> Status, Content, Response
pjs_4 = ParseJSONString(Text=get_3.Content)
gjok_8 = GetJSONObjectKey(JObject=pjs_4, Key="LCIAResults")
gjok_9 = GetJSONObjectKey(JObject=gjok_8, Key="LCIAResult")
panel_14 = Panel("""referenceToLCIAMethodDataSet
other""")
rja_3 = ReadJSONArray(Array=gjok_9)
gjok_10 = GetJSONObjectKey(JObject=rja_3, Key=panel_14)
item = ListItem(List=gjok_10, Index=0, Wrap=True)  # -> Item, Item1
gjok_11 = GetJSONObjectKey(JObject=item.Item1, Key="anies")
gjok_12 = GetJSONObjectKey(JObject=item.Item, Key="shortDescription")
rja_4 = ReadJSONArray(Array=gjok_12)  # -> simplify(JTokens)
sjt_2 = StringifyJSONToken(JToken=gjok_11)
item_2 = ListItem(List=rja_4, Index=0, Wrap=True)
item_3 = ListItem(List=sjt_2, Index=0, Wrap=True)
process_names_2 = Data(process_names)
gjok_13 = GetJSONObjectKey(JObject=item_2, Key="value")
sjt_3 = StringifyJSONToken(JToken=gjok_13)
gwp_by_stages = Data(simplify(item_3))
lcia_method_name = Data(sjt_3)
merge_4 = Merge(Data1=process_names_2, Data2=lcia_method_name, Data3=gwp_by_stages)

panel_15 = Panel(merge_3)
panel_16 = Panel(merge_4)
